# Grasshopper definition 20231109_demo_inflatables.gh (Grasshopper 1.0.8)
# plug-ins: RhinoCodePluginGH, ISheets Info, Weaverbird, ISheetModel, IguanaMesh

number_slider = Slider(0.45, range=0..1)  # disabled

# ----
# Support conditions
X = UnitX(Factor=1)
pt = Point([Point(-0.03683293983, -0.1011976674, 0), Point(0.03683293983, 0.1011976674, 0), Point(0.1104988158, 0.3035930097, 0), Point(0.184164688, 0.5059883595, 0), Point(0.2578305602, 0.7083836794, 0), Point(0.3314964473, 0.9107789993, 0), Point(0.4051623344, 1.113174319, 0), Point(0.4788281918, 1.315569639, 0), Point(0, 0, 0), Point(0.07366587967, 0.2023953348, 0), Point(0.1473317593, 0.4047906697, 0), Point(0.2209976315, 0.6071860194, 0), Point(0.2946635187, 0.8095813394, 0), Point(0.368329376, 1.011976719, 0), Point(0.4419952631, 1.214372039, 0)])
move = Move(Geometry=pt, Motion=X)  # -> Geometry, Transform
support = Support(Point=pt, X=Toggle(True), Y=Toggle(True), Z=Toggle(True), IsTopSheet=Toggle(True), IsTemporary=False)

# ----
# Support conditions
Z = UnitZ(Factor=1)
pt_2 = Point([Point(5.47882843, 6.315569878, 0), Point(5.405162334, 6.113174438, 0), Point(5.331496239, 5.910778999, 0), Point(5.25783062, 5.70838356, 0), Point(5.184164524, 5.505988121, 0), Point(5.110498905, 5.303593159, 0), Point(5.036832809, 5.10119772, 0), Point(4.963167191, 4.89880228, 0), Point(5.441995144, 6.214372158, 0), Point(5.368329525, 6.011976719, 0), Point(5.294663429, 5.80958128, 0), Point(5.22099781, 5.607185841, 0), Point(5.147331715, 5.404790878, 0), Point(5.073666096, 5.202395439, 0), Point(5, 5, 0)])
move_2 = Move(Geometry=pt_2, Motion=Z)  # -> Geometry, Transform
support_2 = Support(Point=pt_2, X=Toggle(True), Y=Toggle(True), Z=Toggle(True), IsTopSheet=Toggle(False), IsTemporary=False)

# ----
# Input data
path = FilePath("/Users/seiichi/Code/inflatablesGH/demos/mesh3.json")
S = Script(filename=path)  # -> out, Mesh, Markers; inputs filename: String
# ---------- S: Python ----------
import Rhino.Geometry as rh
import json

 

with open(filename, 'r') as openfile:
    data = json.load(openfile)
    
    mesh = rh.Mesh()
    for v in data["Vertices"]:
        mesh.Vertices.Add(rh.Point3f(float(v[0]), float(v[1]), float(v[2])))
    
    for v in data["Faces"]:
        mesh.Faces.AddFace(rh.MeshFace(int(v[0]), int(v[1]), int(v[2])))
    
    markers_idx = []
    for idx in data["FinalMarkers"]:
        markers_idx.append(int(idx))
    mesh.Normals.ComputeNormals()
    Mesh = mesh
    Markers = markers_idx
# ---------- end S ----------
wbvertices = WeaverbirdsVerticesComponent(MeshClosedPolylinesGroup=S.Mesh, Weld=False)
item = ListItem(List=wbvertices, Index=S.Markers, Wrap=True)

ilineartria = ILinearTria(
    MinimumSize=number_slider,
    MaximunSize=number_slider,
    CurvatureAdapt=False,
    MininimumElements=6,
    SmoothingSteps=10,
    RightAngles=False,
    Massive_Refinement=False)  # disabled
brep = Brep(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)  # disabled
wbnaked = WeaverbirdsNakedBoundary(MeshClosedPolylines=S.Mesh)
explode = Explode(Curve=wbnaked, Recursive=True)  # -> Segments, Vertices
ipatchbrep = IPatchBrep(Brep=brep, ISettings=ilineartria)  # -> IMesh, Entities, Info; disabled
merge = Merge(Data1=support, Data2=support_2)
mesh = Mesh(ipatchbrep.IMesh)  # disabled

# ----
# Periodic unit data
number_slider_2 = Slider(0.4, range=0..1)
periodicdata = PeriodicData(Mesh=S.Mesh, Pts=item, Pressure=number_slider_2)

pt_3 = Point([Point(7.5, -2.5, 0), Point(7.5, 7.5, 0), Point(-2.5, 7.5, 0), Point(-2.5, -2.5, 0)])
vec = VectorXYZ(XComponent=0, YComponent=0, ZComponent=0)  # -> Vector, Length
pt_4 = Point([Point(7.5, -2.5, 0), Point(7.5, 7.5, 0), Point(-2.5, 7.5, 0), Point(-2.5, -2.5, 0)])
attractedinflatabledata = AttractedInflatableData(Mesh=S.Mesh, Pts=item, Pressure=number_slider_2, Target=mesh)  # disabled
pt_5 = Point([Point(7.5, -2.5, 5.39984183), Point(7.5, 7.5, 0), Point(-2.5, 7.5, 3.677164026), Point(-2.5, -2.5, 0)])
number_slider_3 = Slider(100, range=0..100)
toggle = BooleanToggle(True)
toggle_2 = BooleanToggle(True)
toggle_3 = BooleanToggle(True)
toggle_4 = BooleanToggle(False)
item_2 = ListItem(List=pt_3, Index=0, Wrap=True)  # -> Item, Item1, Item2, Item3
toggle_5 = BooleanToggle(True)
item_3 = ListItem(List=pt_5, Index=0, Wrap=True)  # -> Item, Item1, Item2, Item3
item_4 = ListItem(List=pt_4, Index=0, Wrap=True)  # -> Item, Item1, Item2, Item3
inflatablemodel = InflatableModel(Data=attractedinflatabledata)  # disabled
number_slider_4 = Slider(100, range=0..100)
pt_6 = Point([item_2.Item, item_2.Item2])
attractedsolver = AttractedInflatableSolver(Run=Toggle(False), Reset=Button())  # -> Model, Report
vec_2 = VectorXYZ(XComponent=number_slider_3, YComponent=number_slider_3, ZComponent=number_slider_3)  # -> Vector, Length
pt_7 = Point([item_3.Item, item_3.Item2])
pt_8 = Point([item_4.Item1, item_4.Item3])

# ----
# [OPTIONAL] Saving periodic unit data
# (can be used for running notebooks])
button = Button()
path_2 = FilePath("/Users/suzuki/Desktop/")
write_data = WriteData(Data=periodicdata, Path=path_2, Filename="demo_inflatables", Write=button)

support_3 = Support(Point=pt_6, X=Toggle(True), Y=Toggle(True), Z=Toggle(True), IsTopSheet=Toggle(False), Target=pt_7, IsTemporary=toggle_5)
support_4 = Support(Point=item_4.Item3, X=toggle, Y=toggle_2, Z=toggle_3, IsTopSheet=toggle_4, IsTemporary=toggle_5)
support_5 = Support(Point=item_4.Item1, X=toggle, Y=toggle_2, Z=toggle_3, IsTopSheet=toggle_4, IsTemporary=False)

# ----
# Init model
inflatablemodel_2 = InflatableModel(Data=periodicdata)

button_2 = Button()
merge_2 = Merge(Data1=support_3, Data2=support_5, Data3=support_4)  # -> flatten(Result)

# ----
# Inflatable sheet (inflatable 1)
number_slider_5 = Slider(0.03, range=0..1)
inflatabledata = InflatableData(Mesh=S.Mesh, Pts=item, Supports=merge_2, Pressure=number_slider_5)

# ----
# Inflatable sheet model
inflatablemodel_3 = InflatableModel(Data=inflatabledata)
inflatablesolver = InflatableSolver(Model=inflatablemodel_3, Run=Toggle(False), Reset=Button())  # -> Model, Report

# ----
# Run equilibrium
toggle_6 = BooleanToggle(False)
periodicunitsolver = PeriodicUnitSolver(Model=inflatablemodel_2, Run=toggle_6, Reset=Button())  # -> Model, ExperimentLog

# ----
# Periodic unit model
panel = Panel(periodicunitsolver.ExperimentLog)

# ----
# Strains
dam = DataDam(DataA=periodicunitsolver.Model, BufferDelay=10000000, BufferMode=0)
mesh_2 = Mesh(dam)
inflatablestrains = InflatableStrains(Model=dam)  # -> StrainsPerFace, StrainsPerVertex
bnd = Bounds(Numbers=inflatablestrains.StrainsPerVertex)
dedomain = DeconstructDomain(Domain=bnd)  # -> Start, End
gradient = Gradient(
    LowerLimit=dedomain.End,
    UpperLimit=dedomain.Start,
    Parameter=inflatablestrains.StrainsPerVertex,
    stops=[0: RGB(234, 38, 0), 0.25: RGB(234, 126, 0), 0.5: RGB(254, 244, 84), 0.75: RGB(173, 203, 249), 1: RGB(75, 107, 169)])
mcol = MeshColours(Mesh=mesh_2, Colours=gradient)

# ----
# Compute Stiffness
button_3 = Button()
computestiffness = ComputeStiffness(Model=periodicunitsolver.Model, ShowPlots=button_3)  # -> Bending, BendingCoef, Stretching
