# Grasshopper definition 20240717_demo_inflatables_temporary_supports.gh (Grasshopper 1.0.8)
# plug-ins: RhinoCodePluginGH, ISheets Info, Weaverbird, ISheetModel

# ----
# Input data
path = FilePath("/Users/seiichi/Code/inflatablesGH/demos/mesh3.json")
S = Script(filename=path)  # -> out, Mesh, Markers; inputs filename: String
# ---------- S: Python ----------
import Rhino.Geometry as rh
import json

 

with open(filename, 'r') as openfile:
    data = json.load(openfile)
    
    mesh = rh.Mesh()
    for v in data["Vertices"]:
        mesh.Vertices.Add(rh.Point3f(float(v[0]), float(v[1]), float(v[2])))
    
    for v in data["Faces"]:
        mesh.Faces.AddFace(rh.MeshFace(int(v[0]), int(v[1]), int(v[2])))
    
    markers_idx = []
    for idx in data["FinalMarkers"]:
        markers_idx.append(int(idx))
    mesh.Normals.ComputeNormals()
    Mesh = mesh
    Markers = markers_idx
# ---------- end S ----------
wbvertices = WeaverbirdsVerticesComponent(MeshClosedPolylinesGroup=S.Mesh, Weld=False)
item = ListItem(List=wbvertices, Index=S.Markers, Wrap=True)

# ----
# Support conditions (temporary)
toggle = BooleanToggle(False)
pt = Point([Point(7.5, -2.5, 0), Point(-2.5, 7.5, 0)])
pt_2 = Point([Point(7.5, -2.5, 5.39984183), Point(-2.5, 7.5, 3.677164026)])
support = Support(Point=pt, X=toggle, Y=Toggle(False), Z=Toggle(True), IsTopSheet=Toggle(False), Target=pt_2, IsTemporary=Toggle(True))

# ----
# Support conditions
toggle_2 = BooleanToggle(True)
pt_3 = Point([Point(7.5, 7.5, 0), Point(-2.5, -2.5, 0)])
support_2 = Support(Point=pt_3, X=toggle_2, Y=Toggle(True), Z=Toggle(True), IsTopSheet=Toggle(False), IsTemporary=False)

merge = Merge(Data1=support, Data2=support_2)  # -> flatten(Result)
panel = Panel(merge)

# ----
# Inflatable sheet (inflatable 1)
number_slider = Slider(0.03, range=0..1)
inflatabledata = InflatableData(Mesh=S.Mesh, Pts=item, Supports=merge, Pressure=number_slider)

isheetsolveroptions = IsheetSolverOptions(
    Iterations0=Slider(22, range=0..100),
    Iterations1=Slider(23, range=0..100),
    SubIterations=5,
    GradTol=1e-10,
    HessianShiftForRigidMotion=1e-10,
    HessianShiftForAlphaInPlanar=1e-12,
    UseTensionFieldEnergy=True,
    UseHessianProjectedEnergy=False,
    DisableFusedRegionTensionFieldTheory=False,
    reportType=0)
isheetsolveroptions_2 = IsheetSolverOptions(
    Iterations0=Slider(22, range=0..100),
    Iterations1=Slider(23, range=0..100),
    SubIterations=5,
    GradTol=1e-10,
    HessianShiftForRigidMotion=1e-10,
    HessianShiftForAlphaInPlanar=1e-12,
    UseTensionFieldEnergy=True,
    UseHessianProjectedEnergy=False,
    DisableFusedRegionTensionFieldTheory=False,
    reportType=2)

# ----
# Inflatable sheet model
inflatablemodel = InflatableModel(Data=inflatabledata)
inflatablesolver = InflatableSolver(Model=inflatablemodel, Opts=isheetsolveroptions_2, Run=Toggle(False), Reset=Button())  # -> Model, Report

# ----
# DynamicSolver
toggle_3 = BooleanToggle(False)
inflatabledynamicsolver = InflatableDynamicSolver(Model=inflatablemodel, Opts=isheetsolveroptions_2, Run=toggle_3, Reset=Button())  # -> Model, Report

energies = Energies(InflatedModel=inflatablesolver.Model)
energies_2 = Energies(InflatedModel=inflatabledynamicsolver.Model)
panel_2 = Panel(inflatablesolver.Report)
panel_3 = Panel(inflatabledynamicsolver.Report)
panel_4 = Panel(energies)
panel_5 = Panel(energies_2)
