# Grasshopper definition ex01_inflatable.gh (Grasshopper 1.0.8)
# plug-ins: ISheets Info, ISheetModel

# ----
# Inflatable IO
mesh = Mesh(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)
pt = Point([Point(-2.403457018, 1.580756694, 0), Point(-2.205574887, 1.609785345, 0), Point(-2.007692757, 1.638813997, 0), Point(-1.809810627, 1.667842648, 0), Point(-1.75243961, 1.582939046, 0), Point(-1.821736444, 1.395327882, 0)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])

# ----
# Inflatable data
inflatable_data = InflatableData(Mesh=mesh, Pts=pt, Pressure=Slider(0.4, range=0..1), dataType=0)

# ----
# Inflatable model
inflatable_model = InflatableModel(Data=inflatable_data)

# ----
# Simulation
toggle = BooleanToggle(False)
step_inflation = StepInflation(Model=inflatable_model, Run=toggle, Reset=Button(), SaveSteps=False)  # -> Model, Report, Meshes

# ----
# Strains
dam = DataDam(DataA=step_inflation.Model, BufferDelay=10000000, BufferMode=0)
strains = Strains(Model=dam, Alpha=Slider(1, range=0..1), cmapIdx=1)  # -> Mesh, PerFace, PerVertex
