# Grasshopper definition ex02_inflatable_supports.gh (Grasshopper 1.0.8)
# plug-ins: ISheets Info, ISheetModel

# ----
# Support conditions
toggle = BooleanToggle(True)
pt = Point([Point(7.5, 7.5, 0), Point(-2.5, -2.5, 0)])
support = Support(Point=pt, X=toggle, Y=toggle, Z=toggle, IsTopSheet=Toggle(False), IsTemporary=False)

# ----
# Support conditions (temporary)
toggle_2 = BooleanToggle(True)
pt_2 = Point([Point(7.5, -2.5, 0), Point(-2.5, 7.5, 0)])
pt_3 = Point([Point(7.5, -2.5, 5.39984183), Point(-2.5, 7.5, 3.677164026)])
support_2 = Support(Point=pt_2, X=toggle_2, Y=toggle_2, Z=toggle_2, IsTopSheet=Toggle(False), Target=pt_3, IsTemporary=Toggle(True))

# ----
# Inflatable IO
mesh = Mesh(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)
pt_4 = Point([Point(-0.4788281918, -1.315569639, 0), Point(-0.4051623344, -1.113174319, 0), Point(-0.3314964473, -0.9107789993, 0), Point(-0.2578305602, -0.7083836794, 0), Point(-0.184164688, -0.5059883595, 0), Point(-0.1104988158, -0.3035930097, 0)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])

merge = Merge(Data1=support_2, Data2=support)  # -> flatten(Result)

# ----
# Inflatable data
inflatable_data = InflatableData(Mesh=mesh, Pts=pt_4, Supports=merge, Pressure=Slider(0.4, range=0..1), dataType=0)

# ----
# Inflatable model
inflatable_model = InflatableModel(Data=inflatable_data)

# ----
# Simulation
toggle_3 = BooleanToggle(False)
step_inflation = StepInflation(Model=inflatable_model, Run=toggle_3, Reset=Button(), SaveSteps=False)  # -> Model, Report, Meshes
