# Grasshopper definition ex03_multilayer.gh (Grasshopper 1.0.8)
# plug-ins: ISheets Info, ISheetModel

merge = Merge(Data1=Slider(0.25, range=0..1), Data2=Slider(0, range=0..1), Data3=Slider(0.9, range=0..1))

# ----
# Multilayer
mesh = Mesh(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)

data = Data(Tree({0;0}: [Point(0.08775825799, 0.1000000015, 0), Point(0.216891259, 0.08109631389, 0), Point(0.3487597108, 0.03153223544, 0), Point(0.473880589, -0.02995335124, 0), Point(0.5920838118, -0.08011436462, 0), Point(0.7127615809, -0.09998623282, 0)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], {0;1}: [Point(1.33931303, 1.349944949, 0), Point(3.839411736, 1.349504828, 0), Point(6.339607716, 1.348626614, 0), Point(8.839897156, 1.347314, 0), Point(1.342099547, 3.84994483, 0), Point(3.84218502, 3.849504948, 0), Point(6.342354298, 3.848626614, 0), Point(8.842603683, 3.847314119, 0), Point(1.344480515, 6.349945068, 0), Point(3.844552279, 6.349504948, 0), Point(6.344694614, 6.348626614, 0), Point(8.844902992, 6.347313881, 0), Point(1.346445441, 8.849945068, 0), Point(3.846503258, 8.849504471, 0), Point(6.346617699, 8.848626137, 0), Point(8.846784592, 8.847313881, 0)], {0;2}: [Point(0.08775825799, 0.1000000015, 0), Point(0.216891259, 0.08109631389, 0), Point(0.3487597108, 0.03153223544, 0), Point(0.473880589, -0.02995335124, 0), Point(0.5920838118, -0.08011436462, 0), Point(0.7127615809, -0.09998623282, 0)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]))

# ----
# Inflatable data
inflatable_data = InflatableData(Mesh=mesh, Pts=data, Pressure=merge, dataType=1)

# ----
# Inflatable model
inflatable_model = InflatableModel(Data=inflatable_data)

# ----
# Simulation
toggle = BooleanToggle(False)
inflation = Inflation(Model=inflatable_model, Run=toggle, Reset=Button())  # -> Model, Report

# ----
# Visualization layers
dam = DataDam(DataA=inflation.Model, BufferDelay=10000000, BufferMode=0)
splitlayers = SplitLayers(Model=dam)
lng = ListLength(List=splitlayers)
series = Series(Start=0, Step=1, Count=lng)
gradient = Gradient(
    LowerLimit=0,
    UpperLimit=lng,
    Parameter=series,
    stops=[0: RGB(243, 57, 0), 0.1: RGB(236, 27, 60), 0.2: RGB(210, 0, 118), 0.3: RGB(103, 0, 120), 0.4: RGB(39, 72, 161), 0.5: RGB(1, 192, 229), 0.6: RGB(18, 178, 90), 0.7: RGB(79, 186, 8), 0.8: RGB(220, 237, 32), 0.9: RGB(247, 159, 20), 1: RGB(243, 57, 0)])
preview = CustomPreview(Geometry=splitlayers, Material=gradient)
