# Grasshopper definition ex04_periodic_unit.gh (Grasshopper 1.0.8)
# plug-ins: ISheets Info, ISheetModel

# ----
# Periodic Unit
mesh = Mesh(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)
pt = Point([Point(-0.4788281918, -1.315569639, 0), Point(-0.4051623344, -1.113174319, 0), Point(-0.3314964473, -0.9107789993, 0), Point(-0.2578305602, -0.7083836794, 0), Point(-0.184164688, -0.5059883595, 0), Point(-0.1104988158, -0.3035930097, 0)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])

# ----
# Inflatable data
inflatable_data = InflatableData(Mesh=mesh, Pts=pt, Pressure=Slider(0.4, range=0..1), dataType=2)

# ----
# Inflatable model
inflatable_model = InflatableModel(Data=inflatable_data)

# ----
# Simulation
toggle = BooleanToggle(True)
solveroptions = SolverOptions(Iterations0=20, Iterations1=0, GradTol=1e-10, TwoStepsPeridicUnitSolve=toggle, reportType=0)
inflation = Inflation(Model=inflatable_model, Opts=solveroptions, Run=Toggle(False), Reset=Button())  # -> Model, Report

# ----
# Compute stiffness
button = Button()
dam = DataDam(DataA=inflation.Model, BufferDelay=10000000, BufferMode=0)
stiffness = Stiffness(Model=dam, ShowPlots=button)  # -> Bending, BendingCoef, Stretching
